# Grasshopper definition g-code-Viewer-Performance.ghx (Grasshopper 0.9.76)
# plug-ins: Python Interpreter

# X , Y , Z
# 
# position
# 
# [Point3d , polyline]
# 
# -----
# 
# F
# 
# Feedrate in mm per minute.
# (Speed of print head movement)
# 
# [colorRGB]
# 
# -----
# E
path = FilePath("C:\Users\yoshioca\Documents\gh-g-code-Veiwer\170228_M_V.txt")
panel = Panel(path)
file = ReadFile(File=path, PerLineParse=True)
panel_2 = Panel(file)
graft = GraftTree(Tree=file, IncludeEmptyLists=True, IncludeNullItems=True)
split = TextSplit(Text=file, Separators="Z")
viewer = ParamViewer(split)
split_2 = TextSplit(Text=graft, Separators="X")
dispatch = Dispatch(List=split_2, DispatchPattern=[True, False])  # -> ListA, ListB
split_3 = TextSplit(Text=dispatch.ListB, Separators="Y")
dispatch_2 = Dispatch(List=split_3, DispatchPattern=[True, False])  # -> ListA, ListB
split_4 = TextSplit(Text=dispatch_2.ListB, Separators="Z")
dispatch_3 = Dispatch(List=split_4, DispatchPattern=[True, False])  # -> ListA, ListB
split_5 = TextSplit(Text=dispatch_3.ListB, Separators="F")
dispatch_4 = Dispatch(List=split_5, DispatchPattern=[True, False])  # -> ListA, ListB
flatten = FlattenTree(Tree=dispatch_2.ListA, Path="{0}")
viewer_2 = ParamViewer(flatten)
flatten_2 = FlattenTree(Tree=dispatch_3.ListA, Path="{0}")
viewer_3 = ParamViewer(flatten_2)
flatten_3 = FlattenTree(Tree=dispatch_4.ListA, Path="{0}")
viewer_4 = ParamViewer(flatten_3)
panel_3 = Panel(flatten)
split_6 = TextSplit(Text=dispatch_4.ListB, Separators="E")
python = PythonScript(txt=file)  # -> out, pts, ptE; inputs txt: list
# ---------- python: Python ----------
import rhinoscriptsyntax as rs

ptX = []
ptY = []
ptZ = []
ptF = []
ptE = []

pts = []


for i in xrange(len(txt)):
    
    tmp_str = txt[i]
    
    boolX = "X" in tmp_str
    boolY = "Y" in tmp_str
    boolZ = "Z" in tmp_str
    boolF = "F" in tmp_str
    
    if boolX and boolY and boolZ and boolF:
        tmp_split_X = tmp_str.split("X")
        tmp_split_Y = tmp_split_X[1].split("Y")
        tmp_split_Z = tmp_split_Y[1].split("Z")
        tmp_split_F = tmp_split_Z[1].split("F")
        tmp_split_E = tmp_split_F[1].split("E")
        
        tmp_ptX = tmp_split_Y[0]
        tmp_ptY = tmp_split_Z[0]
        tmp_ptZ = tmp_split_F[0]
        # tmp_ptF = tmp_split_E[0]
        tmp_ptE = tmp_split_E[1]
        
        
        tmp_pt = rs.AddPoint((tmp_ptX, tmp_ptY, tmp_ptZ))
        pts.append(tmp_pt)
        
        
        # ptX.append(tmp_ptX)
        # ptY.append(tmp_ptY)
        # ptZ.append(tmp_ptZ)
        # ptF.append(tmp_ptF)
        ptE.append(tmp_ptE)
# ---------- end python ----------

# ---- group: python -> gh component
python_2 = PythonScript(a=flatten, b=flatten_2, c=flatten_3)  # -> out, pts; inputs a: list, b: list, c: list
# ---------- python_2: Python ----------
import ghpythonlib.components as ghpc

pts = []


for i in xrange(len(a)):
    
    tmp_x = a[i]
    tmp_y = b[i]
    tmp_z = c[i]
    
    tmp_pt = ghpc.ConstructPoint(tmp_x,tmp_y,tmp_z)
    pts.append(tmp_pt)
# ---------- end python_2 ----------

# ---- group: python -> rhinoscript
python_3 = PythonScript(a=flatten, b=flatten_2, c=flatten_3)  # -> out, pts; inputs a: list, b: list, c: list
# ---------- python_3: Python ----------
import rhinoscriptsyntax as rs

pts = []


for i in xrange(len(a)):
    
    tmp_x = a[i]
    tmp_y = b[i]
    tmp_z = c[i]
    
    tmp_pt = rs.AddPoint((tmp_x, tmp_y, tmp_z))
    pts.append(tmp_pt)
# ---------- end python_3 ----------

# ----
pt = ConstructPoint(XCoordinate=flatten, YCoordinate=flatten_2, ZCoordinate=flatten_3)
dispatch_5 = Dispatch(List=split_6, DispatchPattern=[True, False])  # -> ListA, ListB
viewer_5 = ParamViewer(python_3.pts)
panel_4 = Panel(pt)
panel_5 = Panel(python_3.pts)
rev = ReverseList(List=pt)
viewer_6 = ParamViewer(python.ptE)
panel_6 = Panel(python_2.pts)
viewer_7 = ParamViewer(python_2.pts)
split_7 = SplitList(List=pt, Index=1)  # -> ListA, ListB
split_8 = SplitList(List=rev, Index=1)  # -> ListA, ListB

# ---- group: E
flatten_4 = FlattenTree(Tree=dispatch_5.ListB, Path="{0}")

# ---- group: F
flatten_5 = FlattenTree(Tree=dispatch_5.ListA, Path="{0}")

# ----
rev_2 = ReverseList(List=split_8.ListB)
panel_7 = Panel(dispatch_4.ListA)
rev_3 = ReverseList(List=flatten_4)  # disabled
num = Number(flatten_5)
ln = Line(StartPoint=split_7.ListB, EndPoint=rev_2)
split_9 = SplitList(List=flatten_4, Index=1)  # -> ListA, ListB; disabled
split_10 = SplitList(List=rev_3, Index=1)  # -> ListA, ListB; disabled
bnd = Bounds(Numbers=num)
rev_4 = ReverseList(List=split_10.ListB)  # disabled
subtraction = Subtraction(A=split_9.ListB, B=rev_4)  # disabled
remap = RemapNumbers(Value=num, Source=bnd, Target="0 TO 255.0")  # -> Mapped, Clipped
viewer_8 = ParamViewer(subtraction)
bnd_2 = Bounds(Numbers=subtraction)
subtraction_2 = Subtraction(A=255, B=remap.Mapped)
viewer_9 = ParamViewer(ln)
panel_8 = Panel(subtraction)
panel_9 = Panel(bnd_2)
rgb = ColourRGB(Alpha=255, Red=subtraction_2, Green=Slider(0, range=0..1000), Blue=remap.Mapped)
preview = CustomPreview(Geometry=ln, Shader=rgb)
