# Grasshopper definition g-code-Viewer.ghx (Grasshopper 0.9.76)
# plug-ins: Python Interpreter

path = FilePath("C:\Users\yoshioca\Documents\gh-g-code-Veiwer\170228_M_V.txt")
panel = Panel(path)
# X , Y , Z
# 
# position
# 
# [Point3d , polyline]
# 
# -----
# 
# F
# 
# Feedrate in mm per minute.
# (Speed of print head movement)
# 
# [colorRGB]
# 
# -----
# E
file = ReadFile(File=path, PerLineParse=True)
panel_2 = Panel(file)
python = PythonScript(txt=file)  # -> out, pts, ptF, ptE; inputs txt: list
# ---------- python: Python ----------
import rhinoscriptsyntax as rs

ptX = []
ptY = []
ptZ = []
ptF = []
ptE = []

pts = []


for i in xrange(len(txt)):
    
    tmp_str = txt[i]
    
    boolX = "X" in tmp_str
    boolY = "Y" in tmp_str
    boolZ = "Z" in tmp_str
    boolF = "F" in tmp_str
    
    if boolX and boolY and boolZ and boolF:
        tmp_split_X = tmp_str.split("X")
        tmp_split_Y = tmp_split_X[1].split("Y")
        tmp_split_Z = tmp_split_Y[1].split("Z")
        tmp_split_F = tmp_split_Z[1].split("F")
        tmp_split_E = tmp_split_F[1].split("E")
        
        tmp_ptX = tmp_split_Y[0]
        tmp_ptY = tmp_split_Z[0]
        tmp_ptZ = tmp_split_F[0]
        tmp_ptF = tmp_split_E[0]
        tmp_ptE = tmp_split_E[1]
        
        
        tmp_pt = rs.AddPoint((tmp_ptX, tmp_ptY, tmp_ptZ))
        pts.append(tmp_pt)
        
        
        # ptX.append(tmp_ptX)
        # ptY.append(tmp_ptY)
        # ptZ.append(tmp_ptZ)
        ptF.append(tmp_ptF)
        ptE.append(tmp_ptE)
# ---------- end python ----------
pt = Point(python.pts)
rev = ReverseList(List=pt)
num = Number(python.ptF)
split = SplitList(List=pt, Index=1)  # -> ListA, ListB
split_2 = SplitList(List=rev, Index=1)  # -> ListA, ListB
bnd = Bounds(Numbers=num)
rev_2 = ReverseList(List=split_2.ListB)
remap = RemapNumbers(Value=num, Source=bnd, Target="0 TO 255.0")  # -> Mapped, Clipped
subtraction = Subtraction(A=255, B=remap.Mapped)
ln = Line(StartPoint=split.ListB, EndPoint=rev_2)
viewer = ParamViewer(ln)
rgb = ColourRGB(Alpha=255, Red=subtraction, Green=Slider(0, range=0..1000), Blue=remap.Mapped)
preview = CustomPreview(Geometry=ln, Shader=rgb)
